# Grasshopper definition test.gh (Grasshopper 1.0.7)
# plug-ins: RhinoCodePluginGH

x = GetInteger(Slider(2, range=0..10), AtLeast=1, AtMost=1, Maximum=2147483647, Minimum=-2147483648, TreeAccess=False)
y = GetInteger(Slider(2, range=0..10), AtLeast=1, AtMost=1, Maximum=2147483647, Minimum=-2147483648, TreeAccess=False)
S = Script(x=x, y=y)  # -> out, a
# ---------- S: Python ----------
"""Grasshopper Script"""
a = x + y
print(a)
# ---------- end S ----------
context_bake = ContextBake(Content=S.a)
